# Grasshopper definition Attractor_Rotate_MoveToPoint2.gh (Grasshopper 1.0.7)
# plug-ins: LunchBox, Pufferfish

unit_max_size = Slider(2.3, range=0..10)
unit_min_size = Slider(0.31, range=0.01..1)
# Attractor curve(s)
number_slider = Slider(18, range=0..100)
crv = Curve(<curve referenced from the Rhino model>)
rotate = Slider(2, range=0..100)

# ---- group: Set shape
height = Slider(90, range=50..100)
# Parametric Cylinder
number_slider_2 = Slider(30, range=23..35)
Z = UnitZ(Factor=height)
cir = Circle(Plane=PlaneXY(0, 0, 0), Radius=number_slider_2)
extr = Extrude(Base=cir, Direction=Z)

# Custom Extrusion
# Custom Rhino Shape
number_slider_3 = Slider(136, range=0..200)
crv_2 = Curve()
Z_2 = UnitZ(Factor=number_slider_3)
extr_2 = Extrude(Base=crv_2, Direction=Z_2)

brep = Brep()

# ----
brep_2 = Brep(extr)

edges = BrepEdges(Brep=brep_2)  # -> Naked, Interior, NonManifold
unroll = UnrollBrep(Brep=brep_2, JoinUnrolled=False)

boundary = BoundarySurfaces(Edges=unroll)
xy = XYPlane(Origin=Point(0, 0, 0))
diagrid = DiagridStructure(Surface=boundary, UDivisions=number_slider, VDivisions=Slider(8, range=0..100), Type=True)  # -> StructureLines, StructureNodes
project = Project(Geometry=edges.Naked, Plane=xy)  # -> Geometry, Transform
pt = Point(diagrid.StructureNodes)
incurve = PointInCurve(Point=pt, Curve=unroll)  # -> Relationship, Point
integer_division = IntegerDivision(A=incurve.Relationship, B="2")
cull = CullPattern(List=pt, CullPattern=integer_division)

# ----
# Custom pattern unit
crv_3 = Curve()
area = Area(Geometry=crv_3)  # -> Area, Centroid
move2pt = MoveToPoint(Geometry=crv_3, PointA=area.Centroid, PointB=cull)  # -> Moved, Vector, Transform

# ----
# Polygon Pattern Unit
number_slider_4 = Slider(3, range=3..10)
polygon = Polygon(Plane=cull, Radius=Slider(2.7, range=0..10), Segments=number_slider_4, FilletRadius=0)  # -> Polygon, Length

lng = ListLength(List=cull)
crv_cp = CurveClosestPoint(Point=cull, Curve=crv)  # -> Point, Parameter, Distance
dom = ConstructDomain(DomainStart=unit_min_size, DomainEnd=unit_max_size)
series = Series(Start=0, Step=rotate, Count=lng)
bnd = Bounds(Numbers=crv_cp.Distance)
remap = RemapNumbers(Value=crv_cp.Distance, Source=bnd, Target=dom)  # -> Mapped, Clipped
rotate_2 = Rotate(Geometry=polygon.Polygon, Angle=flatten(series), Plane=cull)  # -> Geometry, Transform
vec2pt = Vector2Pt(PointA=cull, PointB=cull, Unitize=False)  # -> Vector, Length
geo = Geometry(rotate_2.Geometry)
scale = Scale(Geometry=geo, Center=cull, Factor=remap.Mapped)  # -> Geometry, Transform
geo_2 = Geometry(project.Geometry)
edges_2 = BrepEdges(Brep=unroll)  # -> Naked, Interior, NonManifold
move = Move(Geometry=scale.Geometry, Motion=vec2pt.Vector)  # -> Geometry, Transform
item = ListItem(List=geo_2, Index=0, Wrap=True)
boundary_2 = BoundarySurfaces(Edges=edges_2.Naked)
group = Group(Objects=flatten(move.Geometry))
merge = Merge(Data1=item, Data3=group, Data4=boundary_2, Data5=brep_2)
