# Grasshopper definition LAMP_VerticalSlice.gh (Grasshopper 1.0.7)

feature_multiplicator = Slider(10, range=0..10)
vertical_resolution = Slider(10, range=0..1000)
height = Slider(144.5, range=0..500)
range = Range(Domain=Domain(0, 1), Steps=vertical_resolution)
graph = GraphMapper(
    range,
    x0=0,
    x1=1,
    y0=0,
    y1=1,
    A=0.4909080801,
    B=0.2603149414,
    container_name="Linear",
    Graph_x0=0,
    Graph_x1=0.6154174805,
    Graph_y0=0.2603149414,
    Graph_y1=0.5624283552)
graph_2 = GraphMapper(range, x0=0, x1=1, y0=0, y1=1, container_name="Sine", Equation_px=[0, 0.1349499673], Equation_py=[0, 0.8095143437])
multiplication = Multiplication(A=range, B=height)
multiplication_2 = Multiplication(A=graph_2, B=feature_multiplicator)
multiplication_3 = Multiplication(A=Slider(58.4, range=0..100), B=graph)
addition = Addition(A=multiplication_3, B=multiplication_2)
pt = PointCylindrical(BasePlane=PlaneXY(0, 0, 0), Angle=0, Radius=addition, Elevation=multiplication)
intcrv = Interpolate(Vertices=pt, Degree=3, Periodic=False, KnotStyle=1)  # -> Curve, Length, Domain
arrpolar = PolarArray(Geometry=intcrv.Curve, Plane=PlaneXY(0, 0, 0), Count=10, Angle=6.283185307)  # -> Geometry, Transform
loft = Loft(
    Curves=arrpolar.Geometry,
    Options={Adjust=False, Closed=True, LoftEnds=0, LoftSimp=0, LoftType=0, Rebuild=10, Refit=0.01})
preview = CustomPreview(
    Geometry=loft,
    Material={diffuse=RGB(221, 160, 221), emission=RGB(66, 48, 66), shine=0.5, specular=RGB(255, 255, 255), transparency=0})
