# Grasshopper definition LampGenerator.gh (Grasshopper 1.0.7)

crv = Curve(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)
crv_2 = Curve(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)
crv_3 = Curve([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])
curvepoint = PointOnCurve(crv_2, parameter=0.5)
disc = Discontinuity(Curve=crv, Level=1)  # -> Points, Parameters
item = ListItem(List=crv_3, Index=0, Wrap=True)
curvepoint_2 = PointOnCurve(item, parameter=1)
item_2 = ListItem(List=disc.Points, Index=0, Wrap=True)
pdecon = Deconstruct(Point=curvepoint)  # -> XComponent, YComponent, ZComponent
pdecon_2 = Deconstruct(Point=item_2)  # -> XComponent, YComponent, ZComponent
pdecon_3 = Deconstruct(Point=curvepoint_2)  # -> XComponent, YComponent, ZComponent
pt = ConstructPoint(XCoordinate=pdecon.XComponent, YCoordinate=expr("x-5", pdecon.YComponent), ZCoordinate=pdecon.ZComponent)
pt_2 = ConstructPoint(XCoordinate=pdecon_2.XComponent, YCoordinate=expr("x-5", pdecon_2.YComponent), ZCoordinate=pdecon_2.ZComponent)
pt_3 = ConstructPoint(XCoordinate=pdecon_3.XComponent, YCoordinate=pdecon_3.YComponent, ZCoordinate=expr("X+5", pdecon_3.ZComponent))
tag = TextTag(Location=pt, Text="MIN_SIZE (diameter) = 90 mm")
tag_2 = TextTag(Location=pt_2, Text="MAX_SIZE = 200 mm")
tag_3 = TextTag(Location=pt_3, Text="MAX_HEIGHT = 200 mm")

pt_4 = ConstructPoint(XCoordinate=0, YCoordinate=0, ZCoordinate=0)

# ----
# 3. Add holes
# Shallow
swatch = ColourSwatch(SwatchColor=RGB(255, 97, 250))
# 2. Set shape params
panel = Panel("""True
True
False
False""")
height = Slider(9, range=0..100)
destance_b_layers = Slider(15, range=0..100)
number_of_creases = Slider(36, range=0..200)
depth_of_crease = Slider(10, range=-50..50)
rotation = Slider(0, range=0..12)
# 1. Set base curve
crv_4 = Curve(<curve referenced from the Rhino model>)

divide = DivideCurve(Curve=crv_4, Count=number_of_creases, Kinks=False)  # -> Points, Tangents, Parameters
neg = Negative(Value=depth_of_crease)
dispatch = Dispatch(List=divide.Points, DispatchPattern=panel)  # -> ListA, ListB
series = Series(Start=0, Step=0.1, Count=height)
vec2pt = Vector2Pt(PointA=pt_4, PointB=dispatch.ListB, Unitize=False)  # -> Vector, Length
series_2 = Series(Start=0, Step=destance_b_layers, Count=height)
pt_5 = Point(dispatch.ListA)
not = GateNot(A=panel)
amp = Amplitude(Vector=vec2pt.Vector, Amplitude=neg)
move = Move(Geometry=dispatch.ListB, Motion=amp)  # -> Geometry, Transform
series_3 = Series(Start=0, Step=rotation, Count=height)
Z = UnitZ(Factor=series_2)
weave = Weave(Pattern=not, Stream0=pt_5, Stream1=move.Geometry, NullGaps=False)
intcrv = Interpolate(Vertices=weave, Degree=3, Periodic=True, KnotStyle=1)  # -> Curve, Length, Domain
move_2 = Move(Geometry=intcrv.Curve, Motion=Z)  # -> Geometry, Transform
area = Area(Geometry=move_2.Geometry)  # -> Area, Centroid
rad = Radians(Degrees=series_3)

graph = GraphMapper(series, x0=0, x1=1, y0=0, y1=1, container_name="Sine", Equation_px=[0, 0.1435854733], Equation_py=[0.7878602743, 1])

scale = Scale(Geometry=move_2.Geometry, Center=area.Centroid, Factor=graph)  # -> Geometry, Transform
rotate = Rotate(Geometry=scale.Geometry, Angle=rad, Plane=PlaneXY(0, 0, 0))  # -> Geometry, Transform
loft = Loft(Curves=rotate.Geometry, Options={Adjust=False, Closed=False, LoftEnds=0, LoftSimp=0, LoftType=0, Rebuild=10, Refit=0.01})

# ---- group: Bottom [shallow]
item_3 = ListItem(List=rotate.Geometry, Index=0, Wrap=True)
crv_5 = Curve([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])
merge = Merge(Data1=item_3, Data2=crv_5)  # -> flatten(Result)
boundary = BoundarySurfaces(Edges=merge)
merge_2 = Merge(Data1=loft, Data2=boundary)  # -> flatten(Result)
join = BrepJoin(Breps=merge_2)  # -> Breps, Closed

# ----
dam = DataDam(DataA=loft, BufferDelay=10000000, BufferMode=0)
preview = CustomPreview(Geometry=join.Breps, Material=swatch)

# ---- group: Bottom [solid]
boundary_2 = BoundarySurfaces(Edges=crv_5)
Z_2 = UnitZ(Factor=250)
extr = Extrude(Base=boundary_2, Direction=Z_2)
cap = CapHoles(Brep=dam)
sdiff = SolidDifference(BrepsA=cap, BrepsB=extr)

# ----
# 4. Bake! [Solid]
brep = Brep(sdiff)
