# Grasshopper definition LampGenerator_CorrugatorFaster.gh (Grasshopper 1.0.7)

number_of_creases = Slider(62, range=0..200)
crv = Curve([<curve referenced from the Rhino model> x10])
graft = GraftTree(Tree=crv, IncludeEmptyLists=True, IncludeNullItems=True)
divide = DivideCurve(Curve=crv, Count=number_of_creases, Kinks=False)  # -> Points, Tangents, Parameters
area = Area(Geometry=graft)  # -> Area, Centroid
cir = Circle(Plane=divide.Points, Radius=Slider(0.5, range=0..3))
pln = Plane(area.Centroid)

python = GhPythonScript(Circles=cir, Slices=graft, Planes=pln, Combine=Toggle(True), Tolerance=Slider(0.1, range=0..1))  # -> Regions; inputs Circles: tree of Curve, Slices: tree of Curve, Planes: tree
# ---------- python: Python ----------
import Rhino as rc
import ghpythonlib.treehelpers as th

sles = th.tree_to_list(Slices)
cles = th.tree_to_list(Circles)
plns = th.tree_to_list(Planes)


Regions = []

for i, branch in enumerate(cles):
    Curves = []
    Curves.append(*sles[i])
    Plane = plns[i][0]
    for item in branch:
        Curves.append(item)
    
    regs = rc.Geometry.Curve.CreateBooleanRegions(Curves, Plane, Combine, Tolerance)
    # Extract regions
    for i in range(regs.RegionCount):
        crvs = regs.RegionCurves(i)
        Regions.extend(crvs)


#for i,branch in enumerate(crvs):
#    for j,item in enumerate(branch):
#        s = str(i) + "[" + str(j) + "] "
#        s += type(item).__name__ + ": "
#        s += str(item)
#        
#        a.append(s)
# ---------- end python ----------

crv_2 = Curve(python)
fillet = Fillet(Curve=crv_2, Radius=Slider(0.5, range=0..10))
reb = RebuildCurve(Curve=fillet, Degree=3, Count=Slider(659, range=0..1000), Tangents=False)
lng = ListLength(List=crv)
simplify = SimplifyTree(Tree=reb, Front=False)
series = Series(Start=0, Step=Slider(0, range=0..10), Count=lng)  # -> simplify(graft(Series))
loft = Loft(
    Curves=flatten(simplify),
    Options={Adjust=False, Closed=False, LoftEnds=0, LoftSimp=0, LoftType=0, Rebuild=10, Refit=0.01})
rotate = Rotate(Geometry=simplify, Angle=degrees(series), Plane=PlaneXY(0, 0, 0))  # -> Geometry, Transform
cap = CapHoles(Brep=loft)
preview = CustomPreview(
    Geometry=cap,
    Material={diffuse=RGB(221, 160, 221), emission=RGB(66, 48, 66), shine=0.5, specular=RGB(255, 255, 255), transparency=0})
