# Grasshopper definition LampGenerator_CorrugatorSlow.gh (Grasshopper 1.0.7)

number_of_creases = Slider(70, range=0..200)
crv = Curve([<curve referenced from the Rhino model> x10])
graft = GraftTree(Tree=crv, IncludeEmptyLists=True, IncludeNullItems=True)
divide = DivideCurve(Curve=crv, Count=number_of_creases, Kinks=False)  # -> Points, Tangents, Parameters
series = Series(Start=0, Step=1, Count=10)  # -> graft(Series)
cir = Circle(Plane=divide.Points, Radius=Slider(1.115, range=0..3))
panel = Panel(series)
runion = RegionUnion(Curves=[graft, cir])
panel_2 = Panel(cir)
rotate = Rotate(Angle=1.570796327, Plane=PlaneXY(0, 0, 0))  # -> Geometry, Transform
fillet = Fillet(Curve=runion, Radius=Slider(0.5, range=0..10))
reb = RebuildCurve(Curve=fillet, Degree=3, Count=Slider(659, range=0..1000), Tangents=False)
loft = Loft(Curves=flatten(reb), Options={Adjust=False, Closed=False, LoftEnds=0, LoftSimp=0, LoftType=0, Rebuild=10, Refit=0.01})
cap = CapHoles(Brep=loft)
preview = CustomPreview(
    Geometry=cap,
    Material={diffuse=RGB(221, 160, 221), emission=RGB(66, 48, 66), shine=0.5, specular=RGB(255, 255, 255), transparency=0})
