# Grasshopper definition LampGenerator_and_CorrugatedFaster.gh (Grasshopper 1.0.7)

# curve to extrusion
pt = ConstructPoint(XCoordinate=0, YCoordinate=0, ZCoordinate=0)
panel = Panel("""True
True
False
False""")
not = GateNot(A=panel)
number_of_creases = Slider(150, range=0..200)

number_of_creases_2 = Slider(36, range=0..200)
destance_b_layers = Slider(12, range=0..100)
depth_of_crease = Slider(-18, range=-50..50)
rotation = Slider(0, range=0..12)
height = Slider(10, range=0..100)
crv = Curve(<curve referenced from the Rhino model>)
# morph from curve to basement
# basement options
number_slider = Slider(0, range=0..0.1)
neg = Negative(Value=depth_of_crease)
series = Series(Start=number_slider, Step=0.1, Count=height)
graph = GraphMapper(
    series,
    x0=0,
    x1=1,
    y0=0,
    y1=1,
    container_name="Sine",
    Equation_px=[0, 0.1304236352],
    Equation_py=[0.8179617524, 0.763314724])
series_2 = Series(Start=0, Step=destance_b_layers, Count=height)
Z = UnitZ(Factor=series_2)
series_3 = Series(Start=0, Step=rotation, Count=height)
rad = Radians(Degrees=series_3)
X = UnitX(Factor=Slider(0, range=0..100))

divide = DivideCurve(Curve=crv, Count=number_of_creases_2, Kinks=False)  # -> Points, Tangents, Parameters
dispatch = Dispatch(List=divide.Points, DispatchPattern=panel)  # -> ListA, ListB
vec2pt = Vector2Pt(PointA=pt, PointB=dispatch.ListB, Unitize=False)  # -> Vector, Length
pt_2 = Point(dispatch.ListA)
amp = Amplitude(Vector=vec2pt.Vector, Amplitude=neg)
move = Move(Geometry=dispatch.ListB, Motion=amp)  # -> Geometry, Transform
weave = Weave(Pattern=not, Stream0=pt_2, Stream1=move.Geometry, NullGaps=False)
intcrv = Interpolate(Vertices=weave, Degree=3, Periodic=True, KnotStyle=1)  # -> Curve, Length, Domain

move_2 = Move(Geometry=intcrv.Curve, Motion=Z)  # -> Geometry, Transform
area = Area(Geometry=move_2.Geometry)  # -> Area, Centroid
scale = Scale(Geometry=move_2.Geometry, Center=area.Centroid, Factor=graph)  # -> Geometry, Transform
rotate = Rotate(Geometry=scale.Geometry, Angle=rad, Plane=PlaneXY(0, 0, 0))  # -> Geometry, Transform
loft = Loft(Curves=rotate.Geometry, Options={Adjust=False, Closed=False, LoftEnds=0, LoftSimp=0, LoftType=0, Rebuild=10, Refit=0.01})
cap = CapHoles(Brep=loft)
move_3 = Move(Geometry=cap, Motion=X)  # -> Geometry, Transform
preview = CustomPreview(Geometry=move_3.Geometry, Material=ColourSwatch(SwatchColor=RGB(255, 97, 250)))

dam = DataDam(DataA=rotate.Geometry, BufferDelay=10000000, BufferMode=0)
crv_2 = Curve(flatten(dam))
graft = GraftTree(Tree=crv_2, IncludeEmptyLists=True, IncludeNullItems=True)
divide_2 = DivideCurve(Curve=crv_2, Count=number_of_creases, Kinks=False)  # -> Points, Tangents, Parameters
cir = Circle(Plane=divide_2.Points, Radius=Slider(0.5, range=0..3))
area_2 = Area(Geometry=graft)  # -> Area, Centroid
pln = Plane(area_2.Centroid)

python = GhPythonScript(Circles=cir, Slices=graft, Planes=pln, Combine=Toggle(True), Tolerance=Slider(0.1, range=0..1))  # -> Regions; inputs Circles: tree of Curve, Slices: tree of Curve, Planes: tree
# ---------- python: Python ----------
import Rhino as rc
import ghpythonlib.treehelpers as th

sles = th.tree_to_list(Slices)
cles = th.tree_to_list(Circles)
plns = th.tree_to_list(Planes)


Regions = []

for i, branch in enumerate(cles):
    Curves = []
    Curves.append(*sles[i])
    Plane = plns[i][0]
    for item in branch:
        Curves.append(item)
    
    regs = rc.Geometry.Curve.CreateBooleanRegions(Curves, Plane, Combine, Tolerance)
    # Extract regions
    for i in range(regs.RegionCount):
        crvs = regs.RegionCurves(i)
        Regions.extend(crvs)
# ---------- end python ----------

crv_3 = Curve(python)
fillet = Fillet(Curve=crv_3, Radius=Slider(0.2, range=0..10))
reb = RebuildCurve(Curve=fillet, Degree=3, Count=Slider(659, range=0..1000), Tangents=False)
lng = ListLength(List=crv_2)
simplify = SimplifyTree(Tree=reb, Front=False)
series_4 = Series(Start=0, Step=Slider(0, range=0..10), Count=lng)  # -> simplify(graft(Series))
loft_2 = Loft(
    Curves=flatten(simplify),
    Options={Adjust=False, Closed=False, LoftEnds=0, LoftSimp=0, LoftType=0, Rebuild=10, Refit=0.01})
rotate_2 = Rotate(Geometry=simplify, Angle=degrees(series_4), Plane=PlaneXY(0, 0, 0))  # -> Geometry, Transform
cap_2 = CapHoles(Brep=loft_2)
preview_2 = CustomPreview(
    Geometry=cap_2,
    Material={diffuse=RGB(221, 160, 221), emission=RGB(66, 48, 66), shine=0.5, specular=RGB(255, 255, 255), transparency=0})
