# Grasshopper definition Lamp_Support_no_plugin.gh (Grasshopper 1.0.7)

list = ValueList({"Trilegged": 1, "Cone": 2}, selected="Cone")

# ----
# Trilegged
# 1. Set scale
# 2. Add top holes
scale = Slider(1, range=0.1..2)

support_bottom_radius = Slider(69, range=45..80)
# 1. Set shape params
bottom_wall_thickness = Slider(-2.5, range=-3..0)
support_top_radius = Slider(52, range=45..100)
support_height = Slider(-60, range=-80..0)
hole_height = Slider(3, range=0..10)
hole_fillet_radius = Slider(3, range=0..10)
# 3. Add top holes
# 4. Bake!
hole_position_z = Slider(-33, range=-80..0)
# 2. Set wire hole params
hole_width = Slider(5, range=0..10)

cir = Circle(Plane=PlaneXY(0, 0, 0), Radius=support_bottom_radius)
subtraction = Subtraction(A=support_bottom_radius, B=2)

neg = Negative(Value=hole_width)
neg_2 = Negative(Value=hole_height)
pt = ConstructPoint(XCoordinate=neg, YCoordinate=0, ZCoordinate=hole_height)
xz = XZPlane(Origin=Point(0, 0, 0))
pt_2 = ConstructPoint(XCoordinate=hole_width, YCoordinate=0, ZCoordinate=neg_2)
rec_2pt = Rectangle2Pt(Plane=xz, PointA=pt, PointB=pt_2, Radius=hole_fillet_radius)  # -> Rectangle, Length
Z = UnitZ(Factor=hole_position_z)
Y = UnitY(Factor=-100)
move = Move(Geometry=rec_2pt.Rectangle, Motion=Z)  # -> Geometry, Transform
move_2 = Move(Geometry=move.Geometry, Motion=Y)  # -> Geometry, Transform
Y_2 = UnitY(Factor=Slider(78, range=0..1000))
extr = Extrude(Base=move_2.Geometry, Direction=Y_2)
cap = CapHoles(Brep=extr)

cir_2 = Circle(Plane=PlaneXY(0, 0, 0), Radius=subtraction)

crv = Curve([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])
geo = Geometry(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)
boundary = BoundarySurfaces(Edges=crv)
Z_2 = UnitZ(Factor=1)
Z_3 = UnitZ(Factor=-100)
move_3 = Move(Geometry=boundary, Motion=Z_2)  # -> Geometry, Transform
scale_2 = Scale(Geometry=geo, Center=Point(0, 0, 0), Factor=scale)  # -> Geometry, Transform
extr_2 = Extrude(Base=move_3.Geometry, Direction=Z_3)

dam = DataDam(DataA=scale_2.Geometry, BufferDelay=10000000, BufferMode=0)

sdiff = SolidDifference(BrepsA=dam, BrepsB=extr_2)

# ----
# 3. Bake!
# Cone/Cylinder
brep = Brep(sdiff)

cir_3 = Circle(Plane=PlaneXY(0, 0, 0), Radius=support_top_radius)
Z_4 = UnitZ(Factor=support_height)
subtraction_2 = Subtraction(A=support_top_radius, B=2)
boundary_2 = BoundarySurfaces(Edges=cir_3)
Z_5 = UnitZ(Factor=bottom_wall_thickness)
cir_4 = Circle(Plane=PlaneXY(0, 0, 0), Radius=subtraction_2)
move_4 = Move(Geometry=cir_4, Motion=Z_5)  # -> Geometry, Transform
boundary_3 = BoundarySurfaces(Edges=move_4.Geometry)
join = BrepJoin(Breps=flatten(boundary_3))  # -> Breps, Closed

move_5 = Move(Geometry=cir, Motion=Z_4)  # -> Geometry, Transform
move_6 = Move(Geometry=cir_2, Motion=Z_4)  # -> Geometry, Transform
loft = Loft(
    Curves=flatten([move_5.Geometry, cir_3]),
    Options={Adjust=False, Closed=False, LoftEnds=0, LoftSimp=0, LoftType=0, Rebuild=10, Refit=0.01})
loft_2 = Loft(
    Curves=flatten([move_4.Geometry, move_6.Geometry]),
    Options={Adjust=False, Closed=False, LoftEnds=0, LoftSimp=0, LoftType=0, Rebuild=10, Refit=0.01})
boundary_4 = BoundarySurfaces(Edges=[move_6.Geometry, move_5.Geometry])

join_2 = BrepJoin(Breps=flatten([boundary_2, loft]))  # -> Breps, Closed
merge = Merge(Data1=join.Breps, Data2=join_2.Breps, Data3=boundary_4, Data4=loft_2)  # -> flatten(Result)
join_3 = BrepJoin(Breps=merge)  # -> Breps, Closed

sdiff_2 = SolidDifference(BrepsA=join_3.Breps, BrepsB=cap)
python = GhPythonScript(crv=list, Trilegged=scale_2.Geometry, Cone=sdiff_2)  # -> out, a; inputs crv: Int32, Trilegged: GeometryBase, Cone: GeometryBase
# ---------- python: Python ----------
if crv == 1:
    a = Trilegged
elif crv == 2:
    a = Cone
# ---------- end python ----------
preview = CustomPreview(Geometry=python.a, Material=ColourSwatch(SwatchColor=RGB(48, 38, 38)))

dam_2 = DataDam(DataA=sdiff_2, BufferDelay=10000000, BufferMode=0)

sdiff_3 = SolidDifference(BrepsA=dam_2, BrepsB=extr_2)

brep_2 = Brep(sdiff_3)
