# Grasshopper definition Lamps_Generator.gh (Grasshopper 1.0.7)
# plug-ins: LunchBox, Pufferfish

unit_max_size = Slider(0.3, range=0..10)
unit_min_size = Slider(1, range=0.01..1)
# Attractor curve(s)
number_slider = Slider(13, range=0..100)
crv = Curve(<curve referenced from the Rhino model>)
rotate = Slider(30, range=0..100)

# ---- group: Set shape
# Parametric Cylinder
height = Slider(80, range=50..120)
Z = UnitZ(Factor=height)
cir = Circle(Plane=PlaneXY(0, 0, 0), Radius=40)
extr = Extrude(Base=cir, Direction=Z)

# ----
brep = Brep(extr)

edges = BrepEdges(Brep=brep)  # -> Naked, Interior, NonManifold
unroll = UnrollBrep(Brep=brep, JoinUnrolled=False)

boundary = BoundarySurfaces(Edges=unroll)
xy = XYPlane(Origin=Point(0, 0, 0))
diagrid = DiagridStructure(Surface=boundary, UDivisions=number_slider, VDivisions=Slider(10, range=0..100), Type=True)  # -> StructureLines, StructureNodes
project = Project(Geometry=edges.Naked, Plane=xy)  # -> Geometry, Transform
pt = Point(diagrid.StructureNodes)
incurve = PointInCurve(Point=pt, Curve=unroll)  # -> Relationship, Point
integer_division = IntegerDivision(A=incurve.Relationship, B="2")
cull = CullPattern(List=pt, CullPattern=integer_division)

# ----
# Custom pattern unit
crv_2 = Curve(<curve referenced from the Rhino model>)
area = Area(Geometry=crv_2)  # -> Area, Centroid
move2pt = MoveToPoint(Geometry=crv_2, PointA=area.Centroid, PointB=cull)  # -> Moved, Vector, Transform

lng = ListLength(List=cull)
crv_cp = CurveClosestPoint(Point=cull, Curve=crv)  # -> Point, Parameter, Distance
dom = ConstructDomain(DomainStart=unit_min_size, DomainEnd=unit_max_size)
series = Series(Start=0, Step=rotate, Count=lng)
bnd = Bounds(Numbers=crv_cp.Distance)
remap = RemapNumbers(Value=crv_cp.Distance, Source=bnd, Target=dom)  # -> Mapped, Clipped
rotate_2 = Rotate(Geometry=move2pt.Moved, Angle=flatten(series), Plane=cull)  # -> Geometry, Transform
vec2pt = Vector2Pt(PointA=cull, PointB=cull, Unitize=False)  # -> Vector, Length
geo = Geometry(rotate_2.Geometry)
scale = Scale(Geometry=geo, Center=cull, Factor=remap.Mapped)  # -> Geometry, Transform
geo_2 = Geometry(project.Geometry)
edges_2 = BrepEdges(Brep=unroll)  # -> Naked, Interior, NonManifold
move = Move(Geometry=scale.Geometry, Motion=vec2pt.Vector)  # -> Geometry, Transform
item = ListItem(List=geo_2, Index=0, Wrap=True)
boundary_2 = BoundarySurfaces(Edges=edges_2.Naked)
join = JoinCurves(Curves=edges_2.Naked, Preserve=False)
crv_3 = Curve(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)
group = Group(Objects=flatten(move.Geometry))
merge = Merge(Data1=item, Data3=group, Data4=boundary_2, Data5=brep, Data6=join, Data7=crv_3)
