# Grasshopper definition pattern_generator.gh (Grasshopper 1.0.7)

scale_rotation = Slider(37, range=0..100)
rec = Rectangle({Plane=PlaneXY(157.079633, 75, 0), Size=Domain2(u=-157.079633..157.079633, v=-75..75)})
scale_x = Slider(0.8, range=0..1)
scale_y = Slider(0.8, range=0..1)

area = Area(Geometry=rec)  # -> Area, Centroid
scale_nu = ScaleNU(Geometry=rec, Plane=area.Centroid, ScaleX=scale_x, ScaleY=scale_y, ScaleZ=1)  # -> Geometry, Transform
pop2d = Populate2D(Region=scale_nu.Geometry, Count=Slider(26, range=0..100), Seed=Slider(8, range=0..10))
polygon = Polygon(Plane=pop2d, Radius=Slider(14, range=0..60), Segments=Slider(4, range=0..30), FilletRadius=Slider(0, range=0..10))  # -> Polygon, Length
lng = ListLength(List=polygon.Polygon)
range = Range(Domain=Domain(0, 1), Steps=expr("x-1", lng))
area_2 = Area(Geometry=polygon.Polygon)  # -> Area, Centroid

graph = GraphMapper(
    range,
    x0=0,
    x1=1,
    y0=0,
    y1=1,
    container_name="Bezier",
    cpx=[0, 0.2481751889, 0.6886863708, 1],
    cpy=[0.08224618435, 0.5873183012, 0.1007239223, 1])

multiplication = Multiplication(A=graph, B=scale_rotation)
rotate = Rotate(Geometry=polygon.Polygon, Angle=degrees(multiplication), Plane=area_2.Centroid)  # -> Geometry, Transform

dam = DataDam(DataA=rotate.Geometry, BufferDelay=10000000, BufferMode=0)

rdiff = RegionDifference(CurvesA=rec, CurvesB=dam)
boundary = BoundarySurfaces(Edges=rdiff)

# ----
# Cylinder
number_slider = Slider(20.051, range=0..100)
box = Box({Plane=PlaneXY(-10, -10, 0), X=Domain(0, 20), Y=Domain(0, 20), Z=Domain(0, 4)})
srf = Surface(<surface referenced from the Rhino model>)
dom = ConstructDomain(DomainStart=0, DomainEnd=number_slider)
dom_2 = ConstructDomain(DomainStart=0, DomainEnd=Slider(19, range=0..100))
dom_3 = ConstructDomain(DomainStart=0, DomainEnd=1)
srfmorph = SurfaceMorph(Geometry=boundary, Reference=box, Surface=srf, UDomain=dom, VDomain=dom_2, WDomain=dom_3)
preview = CustomPreview(
    Geometry=srfmorph,
    Material={diffuse=RGB(221, 160, 221), emission=RGB(66, 48, 66), shine=0.5, specular=RGB(255, 255, 255), transparency=0})
