# Grasshopper definition animated_shadow.gh (Grasshopper 1.0.7)

speed = Slider(0.4, range=0.1..10)
trigger = Trigger(Interval=-1, TimerInterval=5, Target=python)
brep = Brep(<brep referenced from the Rhino model>)

pt = ConstructPoint(XCoordinate=0, YCoordinate=0, ZCoordinate=0)
python = GhPythonScript(state=Toggle(False), speed=speed)  # -> out, a; inputs state: Boolean
# ---------- python: Python ----------
from scriptcontext import sticky


if state:
     sticky["angle"] += speed
     a = sticky["angle"]
else:
    sticky["angle"] = 0
# ---------- end python ----------
rotate = Rotate(Geometry=brep, Angle=degrees(python.a), Plane=pt)  # -> Geometry, Transform
preview = CustomPreview(Geometry=rotate.Geometry, Material=ColourSwatch(SwatchColor=RGB(184, 199, 255)))
